# Grasshopper definition 1-basic-read.gh (Grasshopper 0.9.76)
# plug-ins: Firefly.Core

toggle = BooleanToggle(True)
ports_available = COMPortsAvailable()
timer = Timer(TimerInterval=100, Target=read)
panel = Panel(ports_available)
open_port = OpenClosePort(OpenClosePort=toggle, PortNumber="3", BaudRate="115200")
read = SerialReadGeneric(StartReadingValues=toggle, PortNumber="3")  # -> SerialOutput, StatusMessage
split = TextSplit(Text=read.SerialOutput, Separators=",")
number_slider = Slider(1000, range=0..1000)
len = TextLength(Text=split)
dispatch = Dispatch(List=split, DispatchPattern=len)  # -> ListA, ListB
series = Series(Start=0, Step=Slider(50, range=0..50), Count=8)
num = Number(dispatch.ListA)
panel_2 = Panel(num)
pt = ConstructPoint(XCoordinate=series, YCoordinate=num, ZCoordinate=0)
pline = PolyLine(Vertices=pt, Closed=False)
